vi "Examples.gviweb"   [LabVIEW NXG 3.1.0]
outputs:
  "Names": string[]
  "Values": string[]
uses:
  NI::HTTP::GET.gvi
diagram:
  call "GET.gvi"(url="Examples/Examples.json") -> (body=w1)
  Unflatten From JSON(JSON string=w1, type and defaults=string[] []) -> (value=w2)
  for {
    w3 = each element of w2
    Concatenate Strings("Examples/", w3) -> w5
    call "GET.gvi"(url=w5) -> (body=w6)
    append w6 to w4
  }
  $Values <- w4
  $Names <- w2
