vi "Index.gviweb"   [LabVIEW NXG 3.1.0]
panel controls:
  "C++ Source": string
  "Compile": bool
  "Run": bool
  "Result name": string = "B"
  "plot result": bool
  "Input name": string = "X"
  "Num rand pts": f64 = 100
  "Set input": bool
  "Examples": i32 = "Loading..."(0)
panel indicators:
  "Result": f64[]
  "Output": error
uses:
  CIB::CIB.jsli::CreateCompiler
  CIB::CIB.jsli::CreateRuntime
  WebApp::Examples.gviweb
  CIB::CIB.jsli::ExecuteCompiler
  CIB::CIB.jsli::ExecuteRuntime
  CIB::CIB.jsli::GetSavedResult
  CIB::CIB.jsli::SetInputValue
diagram:
  call "PanelController.gviweb"(panel action="Initialize", run=reference to "Run", compile=reference to "Compile") -> (error out=w1)
  call "PanelController.gviweb"(panel action="Disable Buttons", error in=w1) -> (error out=w2)
  call "CreateCompiler"(error in=w2) -> (compiler refnum=w3, error out=w4)
  call "CreateRuntime"(error in=w2) -> (runtime refnum=w5, error out=w6)
  call "Examples.gviweb"() -> (Names=w7, Values=w8)
  Merge Errors(w4, w6) -> (error out=w9)
  Property Node(instance in=reference to "Examples", "Items"=w7, error in=w9) -> (error out=w10)
  sequence {
    frame 0 {
      Array Index(array=w8) -> (out0[_]=w11)
      $"C++ Source" <- w11
    }
  }
  call "PanelController.gviweb"(panel action="Enable Buttons", error in=w10) -> (error out=w12)
  s1 = u8[] []  # shift register
  while {
    event {
      on "Compile" Value changed {
        call "PanelController.gviweb"(panel action="Disable Buttons", error in=w12) -> (error out=w15)
        call "ExecuteCompiler"(compiler refnum=w3, source=$"C++ Source", error in=w15) -> (wasm=w13, error out=w16)
        call "PanelController.gviweb"(panel action="Enable Buttons", error in=w16) -> (error out=w14)
      }
      on "Run" Value changed {
        Array Size(array=s1) -> (size(s)=w17)
        Is Greater Than 0(x=w17) -> w18
        case (w18) {
          frame False, Default {
            One Button Dialog(message="Compilation not available")
            w14 = w12
          }
          frame True {
            call "PanelController.gviweb"(panel action="Disable Buttons", error in=w12) -> (error out=w19)
            call "ExecuteRuntime"(runtime refnum=w5, wasm=s1, error in=w19) -> (error out=w20)
            call "PanelController.gviweb"(panel action="Enable Buttons", error in=w20) -> (error out=w14)
          }
        }
        w13 = s1
      }
      on "Examples" Value changed {
        Array Index(array=w8) -> (out0[$Examples]=w21)
        $"C++ Source" <- w21
        w13 = u8[] []
        w14 = w12
      }
      on "plot result" Value changed {
        call "PanelController.gviweb"(panel action="Disable Buttons", error in=w12) -> (error out=w22)
        call "GetSavedResult"(runtime refnum=w5, name=$"Result name", error in=w22) -> (return=w23, error out=w24)
        call "PanelController.gviweb"(panel action="Enable Buttons", error in=w24) -> (error out=w14)
        $Result <- w23
        w13 = s1
      }
      on "Set input" Value changed {
        w25 = $"Num rand pts"
        for (N = w25) {
          Random Number() -> (number (0 to 1)=w27)
          append w27 to w26
        }
        call "PanelController.gviweb"(panel action="Disable Buttons", error in=w12) -> (error out=w28)
        call "SetInputValue"(runtime refnum=w5, name=$"Input name", value=w26, error in=w28) -> (error out=w29)
        call "PanelController.gviweb"(panel action="Enable Buttons", error in=w29) -> (error out=w14)
        w13 = s1
      }
    }
    $Output <- w14
    next s1 = w13
    stop if w14
  }
