vi "PanelController.gviweb"   [LabVIEW NXG 3.1.0]
inputs:
  "run": "BooleanControl reference"
  "compile": "BooleanControl reference"
  "panel action": "PanelAction.gtype" = "Initialize"
  "error in": error
outputs:
  "error out": error
types:
  "PanelAction.gtype" = enum{"Initialize", "Disable Buttons", "Enable Buttons"}
diagram:
  s1 = uninitialised  # shift register
  s2 = uninitialised  # shift register
  while {
    case ($"panel action") {
      frame "Initialize" {
        w1 = $run
        w2 = $compile
        w3 = $"error in"
      }
      frame "Disable Buttons" {
        Property Node(instance in=s2, "Disabled"=TRUE, error in=$"error in") -> (error out=w4)
        Property Node(instance in=s1, "Disabled"=TRUE, error in=w4) -> (error out=w3)
        w1 = s1
        w2 = s2
      }
      frame "Enable Buttons" {
        Property Node(instance in=s2, "Disabled"=FALSE, error in=$"error in") -> (error out=w5)
        Property Node(instance in=s1, "Disabled"=FALSE, error in=w5) -> (error out=w3)
        w1 = s1
        w2 = s2
      }
    }
    next s1 = w1
    next s2 = w2
    stop if TRUE
  }
  $"error out" <- w3
